# Grasshopper definition DT_Add1ToEachItem.gh (Grasshopper 1.0.7)

numx = GetNumber(Slider(4.165, range=0..10), AtLeast=1, AtMost=1, Maximum=1.797693135e+308, Minimum=-1.797693135e+308)
dt_add1toeachitem = DT_Add1ToEachItem(x=numx)  # -> out, A; inputs x: list of Double
# ---------- dt_add1toeachitem: C# usings ----------
using System.IO;
using System.Linq;
using System.Data;
using System.Drawing;
using System.Reflection;
using System.Windows.Forms;
using System.Xml;
using System.Xml.Linq;
using System.Runtime.InteropServices;

using Rhino.DocObjects;
using Rhino.Collections;
using GH_IO;
using GH_IO.Serialization;
# ---------- dt_add1toeachitem: C# ----------
    Component.Message = ("Add 1 to each item in list");

    List<double> output = new List<double> ();

    foreach(double item in x)
      output.Add(item + 1);

    A = output;
# ---------- end dt_add1toeachitem ----------

# ---- group: RH_OUT:add_1
number = Number(dt_add1toeachitem.A)

# ----
panel = Panel(number)
