# Grasshopper definition DT_SeriesAndRangeNode.gh (Grasshopper 1.0.7)

intx = GetInteger(Slider(0, range=0..10), AtLeast=1, AtMost=1, Maximum=2147483647, Minimum=-2147483648)
inty = GetInteger(Slider(1, range=1..10), AtLeast=1, AtMost=1, Maximum=2147483647, Minimum=1)
intz = GetInteger(Slider(10, range=0..10), AtLeast=1, AtMost=1, Maximum=2147483647, Minimum=-2147483648)
dt_seriesandrangenode = DT_SeriesAndRangeNode(x=intx, y=inty, z=intz)  # -> out, A, B; inputs x: Int32, y: Int32, z: Int32
# ---------- dt_seriesandrangenode: C# usings ----------
using System.IO;
using System.Linq;
using System.Data;
using System.Drawing;
using System.Reflection;
using System.Windows.Forms;
using System.Xml;
using System.Xml.Linq;
using System.Runtime.InteropServices;

using Rhino.DocObjects;
using Rhino.Collections;
using GH_IO;
using GH_IO.Serialization;
# ---------- dt_seriesandrangenode: C# ----------
    Component.Message = ("Series and Range Node");
    
    List<double> mySeries = CreateSeries(x, y, z);
    List<double> myRange = CreateRange(x, y, z);
    A = mySeries;
    B = myRange;
# ---------- dt_seriesandrangenode: C# additional code ----------
  public List<double> CreateRange(double domainStart, double domainEnd, int steps)
  {
    List<double> list = new List<double>();
    for (int i = 0; i <= steps; i++)
    {
      double num = domainEnd - domainStart;
      double num2 = num / (double) steps;
      double item = domainStart + num2 * (double) i;
      list.Add(item);
    }
    return list;
  }

  public static List<double> CreateSeries(double start, double step, int count)
  {
    List<double> list = new List<double>();
    for (double num = start; num <= start + step * (double) (count - 1); num += step)
    {
      list.Add(num);
    }
    return list;
  }
# ---------- end dt_seriesandrangenode ----------

# ---- group: RH_OUT:my_series
number = Number(dt_seriesandrangenode.A)

# ---- group: RH_OUT:my_range
number_2 = Number(dt_seriesandrangenode.B)

# ----
panel = Panel(number)
panel_2 = Panel(number_2)
