# Grasshopper definition D_01_BasicOperators.gh (Grasshopper 1.0.7)

# I am preparing a lecture on HOPS for friday ,
number_slider = Slider(2, range=0..10)
num1 = GetNumber(number_slider, AtLeast=1, AtMost=1, Maximum=1.797693135e+308, Minimum=-1.797693135e+308)
num2 = GetNumber(Slider(3.68, range=0..10), AtLeast=1, AtMost=1, Maximum=1.797693135e+308, Minimum=-1.797693135e+308)
d_01_basicoperators = D_01_BasicOperators(num1=num1, num2=num2)  # -> out, addition, difference, multiplication, division; inputs num1: Double, num2: Double
# ---------- d_01_basicoperators: C# ----------
    addition = num1 + num2;
    difference = num1 - num2;
    multiplication = num1 * num2;
    division = num1 / num2;
# ---------- end d_01_basicoperators ----------

# ---- group: RH_OUT:additon
number = Number(d_01_basicoperators.addition)

# ---- group: RH_OUT:difference
number_2 = Number(d_01_basicoperators.difference)

# ---- group: RH_OUT:multiplication
number_3 = Number(d_01_basicoperators.multiplication)

# ---- group: RH_OUT:division
number_4 = Number(d_01_basicoperators.division)

# ----
panel = Panel([number, number_2, number_3, number_4])
