# Grasshopper definition D_03_DoubleconversionMathround.gh (Grasshopper 1.0.7)

int = GetInteger(Slider(5.228, range=0..10), AtLeast=1, AtMost=1, Maximum=2147483647, Minimum=-2147483648)
double = GetNumber(Slider(1.9, range=0..10), AtLeast=1, AtMost=1, Maximum=1.797693135e+308, Minimum=-1.797693135e+308)
d_03_doubleconversionmathround = D_03_DoubleconversionMathround(intNum=int, floatingPtNum=double)  # -> out, convertedIntegerNum, convertedFloatingPtNum; inputs intNum: Int32, floatingPtNum: Double
# ---------- d_03_doubleconversionmathround: C# ----------
    int myInt = 0;
    double myDouble = 0;

    //myInt = y;      // error: explicit conversion needed (to make sure you know, you would lose data)
    myInt = (int) floatingPtNum; // ok, explicit conversion means "I know I lose fraction values"
    myDouble = intNum;   // ok, implicit conversion allowed, because no information is lost

    //myInt = Math.Round(y); // error: Math.Round returns a floating point number, so you need an explicit conversion
    myInt = (int) Math.Round(floatingPtNum); // ok

    convertedIntegerNum = myInt;
    convertedFloatingPtNum = myDouble;
# ---------- end d_03_doubleconversionmathround ----------

# ---- group: RH_OUT:convertedInt
number = Number(d_03_doubleconversionmathround.convertedIntegerNum)

# ---- group: RH_OUT:convertedDouble
number_2 = Number(d_03_doubleconversionmathround.convertedFloatingPtNum)

# ----
panel = Panel([number, number_2])
