# Grasshopper definition D_03_IntegerDivision.gh (Grasshopper 1.0.7)

num1 = GetNumber(Slider(2, range=0..10), AtLeast=1, AtMost=1, Maximum=1.797693135e+308, Minimum=-1.797693135e+308)
num2 = GetNumber(Slider(1.6, range=0..10), AtLeast=1, AtMost=1, Maximum=1.797693135e+308, Minimum=-1.797693135e+308)
d_03_integerdivision = D_03_IntegerDivision(integerNum1=num1, integerNum2=num2)  # -> out, integerDivision; inputs integerNum1: Int32, integerNum2: Int32
# ---------- d_03_integerdivision: C# ----------
    integerDivision =  integerNum1 / integerNum2;
    //fraction numbers will be lost
# ---------- end d_03_integerdivision ----------

# ---- group: RH_OUT:int_division
number = Number(d_03_integerdivision.integerDivision)

# ----
panel = Panel(number)
