# Grasshopper definition D_05_IntegerModuloDivision.gh (Grasshopper 1.0.7)

num1 = GetNumber(Slider(10, range=0..10), AtLeast=1, AtMost=1, Maximum=1.797693135e+308, Minimum=-1.797693135e+308)
num2 = GetNumber(Slider(2, range=0..10), AtLeast=1, AtMost=1, Maximum=1.797693135e+308, Minimum=-1.797693135e+308)
d_05_integermodulodivision = D_05_IntegerModuloDivision(num1=num1, num2=num2)  # -> out, integerDivision, remainder; inputs num1: Double, num2: Double
# ---------- d_05_integermodulodivision: C# usings ----------
using System.IO;
using System.Linq;
using System.Data;
using System.Drawing;
using System.Reflection;
using System.Windows.Forms;
using System.Xml;
using System.Xml.Linq;
using System.Runtime.InteropServices;

using Rhino.DocObjects;
using Rhino.Collections;
using GH_IO;
using GH_IO.Serialization;
# ---------- d_05_integermodulodivision: C# ----------
    integerDivision = (int) (num1 / num2);
    remainder = num1 % num2;
# ---------- end d_05_integermodulodivision ----------

# ---- group: RH_OUT:remainder
number = Number(d_05_integermodulodivision.remainder)

# ---- group: RH_OUT:int_division
number_2 = Number(d_05_integermodulodivision.integerDivision)

# ----
panel = Panel([number_2, number])
