# Grasshopper definition D_06_EqualityVSAssignment.gh (Grasshopper 1.0.7)

numx = GetNumber(Slider(2, range=0..10), AtLeast=1, AtMost=1, Maximum=1.797693135e+308, Minimum=-1.797693135e+308)
numy = GetNumber(Slider(4, range=0..10), AtLeast=1, AtMost=1, Maximum=1.797693135e+308, Minimum=-1.797693135e+308)
d_06_equalityvsassignment = D_06_EqualityVSAssignment(x=numx, y=numy)  # -> out, equal; inputs x: Int32, y: Int32
# ---------- d_06_equalityvsassignment: C# usings ----------
using System.IO;
using System.Linq;
using System.Data;
using System.Drawing;
using System.Reflection;
using System.Windows.Forms;
using System.Xml;
using System.Xml.Linq;
using System.Runtime.InteropServices;

using Rhino.DocObjects;
using Rhino.Collections;
using GH_IO;
using GH_IO.Serialization;
# ---------- d_06_equalityvsassignment: C# ----------
    bool flag = false;

    flag = (x == y);  // == equality operator returns true or false, a boolean type
    //flag2 = (x = y);  // error! = is an assignment operator;

    equal = flag;
# ---------- end d_06_equalityvsassignment ----------

# ---- group: RH_OUT:bool
boolean = Boolean(d_06_equalityvsassignment.equal)

# ----
panel = Panel(boolean)
