# Grasshopper definition D_07_IncrementDecrement.gh (Grasshopper 1.0.7)

numy = GetNumber(Slider(2, range=0..10), AtLeast=1, AtMost=1, Maximum=1.797693135e+308, Minimum=-1.797693135e+308)
numx = GetNumber(Slider(10, range=0..10), AtLeast=1, AtMost=1, Maximum=1.797693135e+308, Minimum=-1.797693135e+308)
numz = GetNumber(Slider(2, range=0..10), AtLeast=1, AtMost=1, Maximum=1.797693135e+308, Minimum=-1.797693135e+308)
d_07_incrementdecrement = D_07_IncrementDecrement(x=numx, y=numy, z=numz)  # -> out, incrementedY, decrementedZ; inputs x: Double, y: Double, z: Double
# ---------- d_07_incrementdecrement: C# ----------
    Print("x += 3; \nx == {0}", x += 3);
    Print("x -= 6.4; \nx == {0}", x -= 6.4);
    Print("x *= 2; \nx == {0}", x *= 2);
    Print("x /= 3.5; \nx == {0}", x /= 3.5);


    y++;      //now y equals y+1
    incrementedY = y++; // incrementedY equals y before y++, but afterwards y equals y+2(in summary)
    decrementedZ = --z; // decrementedZ equals (z-1) and z equals (z-1) too.
    // if you put incrementation/ decrementation operator before a variable,
    // then it's computed before the statement. Otherwise it's computed afterwards
# ---------- end d_07_incrementdecrement ----------

# ---- group: RH_OUT:incrementY
number = Number(d_07_incrementdecrement.incrementedY)

# ---- group: RH_OUT:incrementZ
number_2 = Number(d_07_incrementdecrement.decrementedZ)

# ----
panel = Panel(number_2)
