# Grasshopper definition E_01_IfStatement.gh (Grasshopper 1.0.7)

numx = GetNumber(Slider(2, range=0..10), AtLeast=1, AtMost=1, Maximum=1.797693135e+308, Minimum=-1.797693135e+308)
numy = GetNumber(Slider(4.13, range=0..10), AtLeast=1, AtMost=1, Maximum=1.797693135e+308, Minimum=-1.797693135e+308)
e_01_ifstatement = E_01_IfStatement(x=numx, y=numy)  # -> out; inputs x: Double, y: Double
# ---------- e_01_ifstatement: C# ----------
    // Curly braces {} separate a block of code (multiple statements) that will be executed inside an "if()" statement
    
    // Remember! If there is only a single instruction after "if()" you may omit the braces!
    
    if(x > y) 
    {
      Print("x is larger than y");
    }
    if(x < y) 
    {
      Print("x is smaller than y");
    }
    if(x == y) 
    {
      Print("x is equal to y");
    }
# ---------- end e_01_ifstatement ----------

# ---- group: RH_OUT:if_statement
text = Text(e_01_ifstatement)

# ----
panel = Panel(text)
