# Grasshopper definition E_02_IfElse.gh (Grasshopper 1.0.7)

gene_pool = GenePool(
    Decimals=2,
    Maximum=10,
    Minimum=-10,
    Value=[-1.298661526, -2.953324482, 4.377850413, 6.085815316, 9.880462224, 5.24721775, 6.985251204, 0.0499097584, 7.411932367, 4.471192423])
numx = GetNumber(gene_pool, AtLeast=1, AtMost=1, Maximum=1.797693135e+308, Minimum=-1.797693135e+308)
e_02_ifelse = E_02_IfElse(x=numx)  # -> out; inputs x: Double
# ---------- e_02_ifelse: C# ----------
    if(x > 0) {
      Print("x is larger than zero");
    }
    else {
      Print("x is equal or smaller than zero");
    }
# ---------- end e_02_ifelse ----------

# ---- group: RH_OUT:if_else
text = Text(e_02_ifelse)

# ----
panel = Panel(text)
