# Grasshopper definition E_03_ElseIf.gh (Grasshopper 1.0.7)

age = GetInteger(Slider(40, range=0..100), AtLeast=1, AtMost=1, Maximum=2147483647, Minimum=-2147483648)
e_03_elseif = E_03_ElseIf(yourAge=age)  # -> out, A; inputs yourAge: Int32
# ---------- e_03_elseif: C# ----------
    if(yourAge >= 40)
      Print("You can be a president in Germany!");
    else if(yourAge >= 18)    // instead of if(yourAge < 40 && yourAge >= 18)
      Print("You can vote in election");
    else
      Print("You can watch TV");
# ---------- end e_03_elseif ----------

# ---- group: RH_OUT:else_if
text = Text(e_03_elseif.out)

# ----
panel = Panel(text)
