# Grasshopper definition E_04_ChangeFlowWitBraces.gh (Grasshopper 1.0.7)

boolx = GetInteger(Toggle(True), AtLeast=1, AtMost=1, Maximum=2147483647, Minimum=-2147483648)
e_04_changeflowwitbraces = E_04_ChangeFlowWitBraces(x=boolx)  # -> out; inputs x: Boolean
# ---------- e_04_changeflowwitbraces: C# usings ----------
using System.IO;
using System.Linq;
using System.Data;
using System.Drawing;
using System.Reflection;
using System.Windows.Forms;
using System.Xml;
using System.Xml.Linq;
using System.Runtime.InteropServices;

using Rhino.DocObjects;
using Rhino.Collections;
using GH_IO;
using GH_IO.Serialization;
# ---------- e_04_changeflowwitbraces: C# ----------
    //Remember! If there is only a single instruction after "if()" you may omit the braces!

    if(x == true)
    {
      Print("Always true");
      if(x == false)
        Print("Never here");
    }
    else
      Print("It depends on braces");
# ---------- end e_04_changeflowwitbraces ----------

# ---- group: RH_OUT:if_braces
text = Text(e_04_changeflowwitbraces)

# ----
panel = Panel(text)
