# Grasshopper definition E_05_DisjunctionConjunctionNegation.gh (Grasshopper 1.0.7)

boola = GetInteger(Toggle(True), AtLeast=1, AtMost=1, Maximum=2147483647, Minimum=-2147483648)
boolb = GetInteger(Toggle(True), AtLeast=1, AtMost=1, Maximum=2147483647, Minimum=-2147483648)
e_05_disjunctionconjunctionnegation = E_05_DisjunctionConjunctionNegation(a=boola, b=boolb)  # -> out, aAndB, aOrB, notA, notB; inputs a: Boolean, b: Boolean
# ---------- e_05_disjunctionconjunctionnegation: C# usings ----------
using System.IO;
using System.Linq;
using System.Data;
using System.Drawing;
using System.Reflection;
using System.Windows.Forms;
using System.Xml;
using System.Xml.Linq;
using System.Runtime.InteropServices;

using Rhino.DocObjects;
using Rhino.Collections;
using GH_IO;
using GH_IO.Serialization;
# ---------- e_05_disjunctionconjunctionnegation: C# ----------
    if(a == true && b == true)
      aAndB = true;
    else
      aAndB = false;

    aOrB = (a || b) ? true : false;   //same with ternary operator. Also: you don't have to check true/false equality with booleans, because they are true/false themselves

    notA = !a;
    notB = !b;
# ---------- end e_05_disjunctionconjunctionnegation ----------

# ---- group: RH_OUT:and
text = Text(e_05_disjunctionconjunctionnegation.aAndB)

# ---- group: RH_OUT:or
text_2 = Text(e_05_disjunctionconjunctionnegation.aOrB)

# ---- group: RH_OUT:notA
text_3 = Text(e_05_disjunctionconjunctionnegation.notA)

# ---- group: RH_OUT:notB
text_4 = Text(e_05_disjunctionconjunctionnegation.notB)

# ----
panel = Panel([text, text_2, text_3, text_4])
