# Grasshopper definition F_01_Loops.gh (Grasshopper 1.0.7)

iterations = GetInteger(Slider(1, range=1..6), AtLeast=1, AtMost=1, Maximum=6, Minimum=1, Prompt="Input: # of interations desired")
f_01_loops = F_01_Loops(iterations=iterations)  # -> out; inputs iterations: Int32
# ---------- f_01_loops: C# usings ----------
using System.IO;
using System.Linq;
using System.Data;
using System.Drawing;
using System.Reflection;
using System.Windows.Forms;
using System.Xml;
using System.Xml.Linq;
using System.Runtime.InteropServices;

using Rhino.DocObjects;
using Rhino.Collections;
using GH_IO;
using GH_IO.Serialization;
# ---------- f_01_loops: C# ----------
    for(int i = 0; i < iterations; i++)
      Print(i.ToString());
# ---------- end f_01_loops ----------

# ---- group: RH_OUT:loops
text = Text(f_01_loops)

# ----
panel = Panel(text)
