# Grasshopper definition F_03_EvenNumbersLoop.gh (Grasshopper 1.0.7)

integer = GetInteger(Slider(10, range=0..100), AtLeast=1, AtMost=1, Maximum=2147483647, Minimum=-2147483648)
f_03_evennumbersloop = F_03_EvenNumbersLoop(iterations=integer)  # -> out; inputs iterations: Int32
# ---------- f_03_evennumbersloop: C# ----------
    Component.Message = "Even numbers";
    
    for(int i = 0; i < iterations; i++)
    {
      if(i%2 != 0)
        continue;
      Print(i.ToString());
    }
# ---------- end f_03_evennumbersloop ----------

# ---- group: RH_OUT:even_int
integer_2 = Integer(f_03_evennumbersloop)

# ----
panel = Panel(integer_2)
