# Grasshopper definition F_04_BreakContinueLoopWithComponentMessage.gh (Grasshopper 1.0.7)

than = GetInteger(Slider(5, range=0..10), AtLeast=1, AtMost=2147483647, Maximum=2147483647, Minimum=-2147483648)
iterations = GetInteger(Slider(10, range=0..10), AtLeast=1, AtMost=2147483647, Maximum=2147483647, Minimum=-2147483648)
f_04_breakcontinueloopwithcomponentmessa = F_04_BreakContinueLoopWithComponentMessage(iterations=iterations, smallerThan=than)  # -> out; inputs iterations: Int32, smallerThan: Int32
# ---------- f_04_breakcontinueloopwithcomponentmessa: C# usings ----------
using System.IO;
using System.Linq;
using System.Data;
using System.Drawing;
using System.Reflection;
using System.Windows.Forms;
using System.Xml;
using System.Xml.Linq;
using System.Runtime.InteropServices;

using Rhino.DocObjects;
using Rhino.Collections;
using GH_IO;
using GH_IO.Serialization;
# ---------- f_04_breakcontinueloopwithcomponentmessa: C# ----------
    Component.Message = "even numbers";

    for(int i = 0; i < iterations; i++)
    {
      if(i >= smallerThan)
        break;
      if(i % 2 != 0)
        continue;
      Print(i.ToString());
    }
# ---------- end f_04_breakcontinueloopwithcomponentmessa ----------

# ---- group: RH_OUT:break_even_loop
integer = Integer(f_04_breakcontinueloopwithcomponentmessa)

# ----
panel = Panel(integer)
