# Grasshopper definition F_11_ForeachLoop.gh (Grasshopper 1.0.7)

gene_pool = GenePool(Decimals=2, Maximum=100, Minimum=0, Value=[5.219170826, 1.892865357, 39.50499806])
gene_pool_2 = GenePool(Decimals=2, Maximum=100, Minimum=0, Value=[1.38054858, 93.26245063, 56.89066619])
num_list = GetNumber(gene_pool, AtLeast=1, AtMost=1, Maximum=1.797693135e+308, Minimum=-1.797693135e+308)
multiplier = GetNumber(gene_pool_2, AtLeast=1, AtMost=1, Maximum=1.797693135e+308, Minimum=-1.797693135e+308)
f_11_foreachloop = F_11_ForeachLoop(numList=num_list, multiplier=multiplier)  # -> out, multiplied; inputs numList: list of Double, multiplier: Double
# ---------- f_11_foreachloop: C# usings ----------
using System.IO;
using System.Linq;
using System.Data;
using System.Drawing;
using System.Reflection;
using System.Windows.Forms;
using System.Xml;
using System.Xml.Linq;
using System.Runtime.InteropServices;

using Rhino.DocObjects;
using Rhino.Collections;
using GH_IO;
using GH_IO.Serialization;
# ---------- f_11_foreachloop: C# ----------
    List<double> numbers = new List<double>();

    foreach(double val in numList)
      numbers.Add(val * multiplier);

    multiplied = numbers;
# ---------- end f_11_foreachloop ----------

# ---- group: RH_OUT:foreach_list_loop
number = Number(f_11_foreachloop.multiplied)

# ----
param_viewer = ParamViewer(number)
panel = Panel(number)
