# Grasshopper definition G_01_WhileLoop.gh (Grasshopper 1.0.7)

max = GetInteger(Slider(4.52, range=0..10), AtLeast=1, AtMost=1, Maximum=2147483647, Minimum=-2147483648)
g_01_whileloop = G_01_WhileLoop(max=max)  # -> out; inputs max: Double
# ---------- g_01_whileloop: C# usings ----------
using System.IO;
using System.Linq;
using System.Data;
using System.Drawing;
using System.Reflection;
using System.Windows.Forms;
using System.Xml;
using System.Xml.Linq;
using System.Runtime.InteropServices;

using Rhino.DocObjects;
using Rhino.Collections;
using GH_IO;
using GH_IO.Serialization;
# ---------- g_01_whileloop: C# ----------
    int i = 0;
    while(i <= max)
    {
      Print(i.ToString());
      i++;
    }
# ---------- end g_01_whileloop ----------

# ---- group: RH_OUT:whileloop
integer = Integer(g_01_whileloop)

# ----
panel = Panel(integer)
