# Grasshopper definition G_02_WhileLoopBreakContinue.gh (Grasshopper 1.0.7)

max = GetNumber(Slider(100, range=0..100), AtLeast=1, AtMost=1, Maximum=1.797693135e+308, Minimum=-1.797693135e+308)
break = GetInteger(Slider(7, range=0..10), AtLeast=1, AtMost=1, Maximum=2147483647, Minimum=-2147483648)
g_02_whileloopbreakcontinue = G_02_WhileLoopBreakContinue(max=max, breakVal=break)  # -> out; inputs max: Double, breakVal: Int32
# ---------- g_02_whileloopbreakcontinue: C# ----------
    int i = 0;
    while(i <= max)
    {
      if(i == breakVal)
        break;
      if(i % 3 != 0)
      {
        i++;
        continue;
      }
      Print((++i).ToString());
    }
# ---------- end g_02_whileloopbreakcontinue ----------

# ---- group: RH_OUT:break_value_%3
integer = Integer(g_02_whileloopbreakcontinue)

# ----
panel = Panel(integer)
