# Grasshopper definition H_01_DoWhileLoop.gh (Grasshopper 1.0.7)

start = GetInteger(Slider(4, range=0..10), AtLeast=1, AtMost=1, Maximum=2147483647, Minimum=-2147483648)
max = GetNumber(Slider(8, range=0..10), AtLeast=1, AtMost=1, Maximum=1.797693135e+308, Minimum=-1.797693135e+308)
h_01_dowhileloop = H_01_DoWhileLoop(start=start, max=max)  # -> out; inputs start: Int32, max: Double
# ---------- h_01_dowhileloop: C# ----------
    int i = start;
    do
    {
      Print(i.ToString());
      i++;
      if(i > max)
        break;
    }
    while(i < int.MaxValue);  //checking for overflow only
# ---------- end h_01_dowhileloop ----------

# ---- group: RH_OUT:do_while_loop
integer = Integer(h_01_dowhileloop)

# ----
panel = Panel(integer)
