# Grasshopper definition I_01_GotoReturnInstruction.gh (Grasshopper 1.0.7)

numx = GetNumber(Slider(12, range=0..100), AtLeast=1, AtMost=1, Maximum=1.797693135e+308, Minimum=-1.797693135e+308)
numy = GetNumber(Slider(38, range=0..100), AtLeast=1, AtMost=1, Maximum=1.797693135e+308, Minimum=-1.797693135e+308)
i_01_gotoreturninstruction = I_01_GotoReturnInstruction(x=numx, y=numy)  # -> out, biggerNumber; inputs x: Double, y: Double
# ---------- i_01_gotoreturninstruction: C# usings ----------
using System.IO;
using System.Linq;
using System.Data;
using System.Drawing;
using System.Reflection;
using System.Windows.Forms;
using System.Xml;
using System.Xml.Linq;
using System.Runtime.InteropServices;

using Rhino.DocObjects;
using Rhino.Collections;
using GH_IO;
using GH_IO.Serialization;
# ---------- i_01_gotoreturninstruction: C# ----------
    if(x > y)
      goto labelX;
    else
      goto labelY;

    labelX:
      biggerNumber = x;
    return;       // means we are not going anywhere further

    labelY:
      biggerNumber = y;
# ---------- end i_01_gotoreturninstruction ----------

# ---- group: RH_OUT:goto_return
number = Number(i_01_gotoreturninstruction.biggerNumber)

# ----
panel = Panel(number)
