# Grasshopper definition I_02_ExitLoopWithGoto.gh (Grasshopper 1.0.7)

start = GetInteger(Slider(4, range=0..10), AtLeast=1, AtMost=1, Maximum=2147483647, Minimum=-2147483648)
i_02_exitloopwithgoto = I_02_ExitLoopWithGoto(start=start)  # -> out; inputs start: Int32
# ---------- i_02_exitloopwithgoto: C# ----------
    Component.Message = "Countdown";

    int i = start;

    while(true) //infinite loop warning!
    {
      if(i < 0)
        goto exit;
      Print(i.ToString());
      i--;
    }

    exit:
      return;
# ---------- end i_02_exitloopwithgoto ----------

# ---- group: RH_OUT:exit_loop_countdown
number = Number(i_02_exitloopwithgoto)

# ----
panel = Panel(number)
