# Grasshopper definition J_01_TypeCheckingSpecialConversions.gh (Grasshopper 1.0.7)

range = Range(Domain=Domain(0, 1), Steps=10)
construct_point = ConstructPoint(XCoordinate=range, YCoordinate=0, ZCoordinate=0)
interpolate = Interpolate(Vertices=construct_point, Degree=3, Periodic=False, KnotStyle=1)  # -> Curve, Length, Domain
construct_point_2 = ConstructPoint(XCoordinate=0, YCoordinate=0, ZCoordinate=0)
polyline = PolyLine(Vertices=construct_point, Closed=False)
get_geometry = GetGeometry([construct_point_2, polyline], AtLeast=1, AtMost=1, Filter=1073741829)
get_val = GetGeometry([construct_point_2, polyline], AtLeast=1, AtMost=1, Filter=1073741829)
j_01_typecheckingspecialconversions = J_01_TypeCheckingSpecialConversions(val=get_val, geometry=get_geometry)  # -> out, A, B
# ---------- j_01_typecheckingspecialconversions: C# usings ----------
using System.IO;
using System.Linq;
using System.Data;
using System.Drawing;
using System.Reflection;
using System.Windows.Forms;
using System.Xml;
using System.Xml.Linq;
using System.Runtime.InteropServices;

using Rhino.DocObjects;
using Rhino.Collections;
using GH_IO;
using GH_IO.Serialization;
# ---------- j_01_typecheckingspecialconversions: C# ----------
    Component.Message = "Unboxing conversion";

    double num = 0;
    Point3d myPt = new Point3d();
    Polyline myPolyline = new Polyline(); //creates an empty reference

    //GetType() is a method of every object instance
    Print("Type of val: {0}", val.GetType());
    Print("Type of geometry: {0}", geometry.GetType());

    if(val.GetType() == typeof(int))
      num = (int) val;    // works because you can assign an integer to a double

    if(val is double) //another way of checking if unboxing would succeed
      num = (double) val;

    if(geometry is Point3d)
    {
      myPt = (Point3d) geometry;
      B = myPt;
    }

    if(geometry is PolylineCurve)
    {
      ((PolylineCurve) geometry).TryGetPolyline(out myPolyline);    // unboxing followed by calling a method to get a Polyline object
      if(myPolyline != null)  //we have to check if reference is not null
        B = myPolyline;
    }

    A = num;
# ---------- end j_01_typecheckingspecialconversions ----------

# ---- group: Rh_OUT:type
text = Text(j_01_typecheckingspecialconversions.out)

# ---- group: RH_OUT:type_geo
geometry = Geometry(j_01_typecheckingspecialconversions.B)

# ---- group: RH_OUT:checking_num
number = Number(j_01_typecheckingspecialconversions.A)

# ----
panel = Panel(text)
panel_2 = Panel(number)
panel_3 = Panel(geometry)
