# Grasshopper definition J_02_SpecialConversionsTextParsing.gh (Grasshopper 1.0.7)

panel = Panel()
text = GetString(panel, AtLeast=1, AtMost=1)
boolean_toggle = GetInteger(Toggle(True), AtLeast=1, AtMost=1, Maximum=1, Minimum=0)
j_02_specialconversionstextparsing = J_02_SpecialConversionsTextParsing(boolean=boolean_toggle, text=text)  # -> out, booleanToInt, parsedText, parsingResult; inputs boolean: Boolean, text: String
# ---------- j_02_specialconversionstextparsing: C# usings ----------
using System.IO;
using System.Linq;
using System.Data;
using System.Drawing;
using System.Reflection;
using System.Windows.Forms;
using System.Xml;
using System.Xml.Linq;
using System.Runtime.InteropServices;

using Rhino.DocObjects;
using Rhino.Collections;
using GH_IO;
using GH_IO.Serialization;
# ---------- j_02_specialconversionstextparsing: C# ----------
    int myInt = 0;
    double myDouble = 0;
    bool resultTest = false;

    //myInt = _boolean; // error: explicit type conversion required
    //myDouble = _text; // error: how to convert text to a number?

    //myInt = (int) _boolean; // still not ok, because converting false or true into a number
    // requires a special procedure
    //myDouble = (double) _text; // same here

    myInt = Convert.ToInt32(_boolean); // one way of converting is calling a special generic method from Convert class
    //myDouble = Convert.ToDouble(_text);  // you can use Convert.ToDouble method when parsing text
    //myDouble = Double.Parse(_text);      // this is another way of parsing
    resultTest = Double.TryParse(_text, out myDouble);  // this is the best way, because failure doesn't result in program crashing

    booleanToInt = myInt;
    parsedText = myDouble;
    parsingResult = resultTest;
# ---------- end j_02_specialconversionstextparsing ----------

# ---- group: RH_OUT:boolToInt
integer = Integer(j_02_specialconversionstextparsing.booleanToInt)

# ---- group: RH_OUT:parsed_text
integer_2 = Integer(j_02_specialconversionstextparsing.parsedText)

# ---- group: RH_OUT:parsing_result
boolean = Boolean(j_02_specialconversionstextparsing.parsingResult)

# ----
panel_2 = Panel(integer_2)
panel_3 = Panel(integer)
panel_4 = Panel(boolean)
