# Grasshopper definition K_01_CreateEmptyArray.gh (Grasshopper 1.0.7)

count = GetInteger(Slider(12, range=0..100), AtLeast=1, AtMost=1, Maximum=2147483647, Minimum=-2147483648)
k_01_createemptyarray = K_01_CreateEmptyArray(count=count)  # -> out, myArray; inputs count: Int32
# ---------- k_01_createemptyarray: C# ----------
    int[] intArray = new int[count];    //creates an array of <count> elements and initializes them with default values
    myArray = intArray;
# ---------- end k_01_createemptyarray ----------

# ---- group: RH_OUT:empty_array
number = Number(k_01_createemptyarray.myArray)

# ----
panel = Panel(number)
