# Grasshopper definition K_05_Series.gh (Grasshopper 1.0.7)

start = GetInteger(Slider(0, range=0..10), AtLeast=1, AtMost=1, Maximum=2147483647, Minimum=-2147483648)
step = GetInteger(Slider(2, range=0..10), AtLeast=1, AtMost=1, Maximum=2147483647, Minimum=-2147483648)
count = GetInteger(Slider(10, range=0..10), AtLeast=1, AtMost=1, Maximum=2147483647, Minimum=-2147483648)
k_05_series = K_05_Series(start=start, step=step, count=count)  # -> out, S; inputs start: Int32, step: Int32, count: Int32
# ---------- k_05_series: C# ----------
    Component.Message = "Series";

    int[] series = new int[count];

    for(int i = 0; i < count; i++)
    {
      series[i] = start + i * step;
      Print("i: {0}, series[i]: {1} + {2} * {3} = {4}", i, start, i, step, series[i]);
    }

    S = series;
# ---------- end k_05_series ----------

# ---- group: RH_OUT:series
number = Number(k_05_series.S)

# ---- group: RH_OUT:out
text = Text(k_05_series.out)

# ----
panel = Panel(text)
panel_2 = Panel(number)
