# Grasshopper definition K_06_GripOf3DPoints(NestedLoops).gh (Grasshopper 1.0.7)

x = GetInteger(Slider(7, range=0..10), AtLeast=1, AtMost=1, Maximum=2147483647, Minimum=-2147483648)
y = GetInteger(Slider(6, range=0..10), AtLeast=1, AtMost=1, Maximum=2147483647, Minimum=-2147483648)
z = GetInteger(Slider(4, range=0..10), AtLeast=1, AtMost=1, Maximum=2147483647, Minimum=-2147483648)
spacing = GetNumber(Slider(3.67, range=0..10), AtLeast=1, AtMost=2147483647, Maximum=1.797693135e+308, Minimum=-1.797693135e+308)
k_06_gripof3dpoints_nestedloops = K_06_GripOf3DPointsNestedLoops(x=x, y=y, z=z, spacing=spacing)  # -> out, ptGrid; inputs x: Int32, y: Int32, z: Int32, spacing: Double
# ---------- k_06_gripof3dpoints_nestedloops: C# usings ----------
using System.IO;
using System.Linq;
using System.Data;
using System.Drawing;
using System.Reflection;
using System.Windows.Forms;
using System.Xml;
using System.Xml.Linq;
using System.Runtime.InteropServices;

using Rhino.DocObjects;
using Rhino.Collections;
using GH_IO;
using GH_IO.Serialization;
# ---------- k_06_gripof3dpoints_nestedloops: C# ----------
    Component.Message = "Grid of Points";
    
    Point3d[] grid = new Point3d[x * y * z];
    int index = 0;

    for(int i = 0; i < x; i++)
    {
      for(int j = 0; j < y; j++)
      {
        for(int k = 0; k < z; k++)
        {
          Print("i: {0}, j: {1}, k: {2}", i, j, k);
          index = i * y * z + j * z + k;
          grid[index].X = i * spacing;
          grid[index].Y = j * spacing;
          grid[index].Z = k * spacing;
        }
      }
    }

    ptGrid = grid;
# ---------- end k_06_gripof3dpoints_nestedloops ----------

# ---- group: RH_OUT:pt_grid
point = Point(k_06_gripof3dpoints_nestedloops.ptGrid)

# ---- group: RH_OUT:out
text = Text(k_06_gripof3dpoints_nestedloops.out)

# ----
panel = Panel(point)
panel_2 = Panel(text)
