# Grasshopper definition K_06_Range.gh (Grasshopper 1.0.7)

start = GetNumber(Slider(3.09, range=0..10), AtLeast=1, AtMost=1, Maximum=1.797693135e+308, Minimum=-1.797693135e+308)
end = GetNumber(Slider(10, range=0..10), AtLeast=1, AtMost=1, Maximum=1.797693135e+308, Minimum=-1.797693135e+308)
steps = GetInteger(Slider(8, range=0..10), AtLeast=1, AtMost=1, Maximum=2147483647, Minimum=-2147483648)
k_06_range = K_06_Range(start=start, end=end, steps=steps)  # -> out, R; inputs start: Double, end: Double, steps: Int32
# ---------- k_06_range: C# ----------
    Component.Message = "Range";

    Interval domain = new Interval(start, end);
    Print("Created domain: {0} To {1}", domain.T0, domain.T1);

    double[] range = new double[steps + 1];

    for(int i = 0; i <= steps; i++)
    {
      range[i] = domain.T0 + i * (domain.Length / steps);
    }

    R = range;
# ---------- end k_06_range ----------

# ---- group: RH_OUT:out
text = Text(k_06_range.out)

# ---- group: RH_OUT:range
number = Number(k_06_range.R)

# ----
panel = Panel(text)
panel_2 = Panel(number)
