# Grasshopper definition K_08_GridOfPoints(MultiDimArray).gh (Grasshopper 1.0.7)

x = GetInteger(Slider(5, range=0..10), AtLeast=1, AtMost=1, Maximum=2147483647, Minimum=-2147483648)
z = GetInteger(Slider(6, range=0..10), AtLeast=1, AtMost=1, Maximum=2147483647, Minimum=-2147483648)
y = GetInteger(Slider(5, range=0..10), AtLeast=1, AtMost=1, Maximum=2147483647, Minimum=-2147483648)
spacing = GetNumber(Slider(2, range=0..10), AtLeast=1, AtMost=1, Maximum=1.797693135e+308, Minimum=-1.797693135e+308)
k_08_gridofpoints_multidimarray = K_08_GridOfPointsMultiDimArray(x=x, y=y, z=z, spacing=spacing)  # -> out, ptGrid; inputs x: Int32, y: Int32, z: Int32, spacing: Double
# ---------- k_08_gridofpoints_multidimarray: C# ----------
    Point3d[,,] grid = new Point3d[x, y, z];  //a multidimensional array

    for(int i = 0; i < x; i++)
    {
      for(int j = 0; j < y; j++)
      {
        for(int k = 0; k < z; k++)
        {
          Print("i: {0}, j: {1}, k: {2}", i, j, k);
          grid[i, j, k].X = i * spacing;
          grid[i, j, k].Y = j * spacing;
          grid[i, j, k].Z = k * spacing;
        }
      }
    }

    ptGrid = grid;
# ---------- end k_08_gridofpoints_multidimarray ----------

# ---- group: RH_OUT:out
text = Text(k_08_gridofpoints_multidimarray.out)

# ---- group: RH_OUT:ptGrid
point = Point(k_08_gridofpoints_multidimarray.ptGrid)

# ----
panel = Panel(text)
panel_2 = Panel(point)
