# Grasshopper definition L_02_ForeachLoop.gh (Grasshopper 1.0.7)

gene_pool = GenePool(
    Decimals=2,
    Maximum=100,
    Minimum=0,
    Value=[13.95976647, 7.59618888, 62.94268028, 59.43010787, 21.6432396, 64.05892687, 66.40341574, 94.25078421, 89.62971814, 80.26200281])
num_list = GetNumber(gene_pool, AtLeast=1, AtMost=1, Maximum=1.797693135e+308, Minimum=-1.797693135e+308)
multiplier = GetNumber(Slider(3, range=0..10), AtLeast=1, AtMost=1, Maximum=1.797693135e+308, Minimum=-1.797693135e+308)
l_02_foreachloop = L_02_ForeachLoop(numList=num_list, multiplier=multiplier)  # -> out, multiplied; inputs numList: list of Double, multiplier: Double
# ---------- l_02_foreachloop: C# ----------
    List<double> numbers = new List<double>();

    foreach(double val in numList)
      numbers.Add(val * multiplier);

    multiplied = numbers;
# ---------- end l_02_foreachloop ----------

# ---- group: RH_OUT:multiplied
number = Number(l_02_foreachloop.multiplied)

# ----
panel = Panel(number)
