# Grasshopper definition L_03_RemoveItemFromList.gh (Grasshopper 1.0.7)

gene_pool = GenePool(
    Decimals=2,
    Maximum=100,
    Minimum=-100,
    Value=[-16.6758699, 72.18116213, -13.35321223, -44.44166876, -82.07948542, 36.04428467, 90.81823173, 5.47740958, 50.18582621, 4.901383028])
num_list = GetNumber(gene_pool, AtLeast=1, AtMost=1, Maximum=1.797693135e+308, Minimum=-1.797693135e+308)
l_03_removeitemfromlist = L_03_RemoveItemFromList(numList=num_list)  # -> out, culledList; inputs numList: list of Double
# ---------- l_03_removeitemfromlist: C# ----------
    Component.Message = "Cull negative numbers";

    //Wrong approach: it would omit the second of every two consecutive negative numbers!
    /*
    for(int i = 0; i < numList.Count; i++)
    {
      if(numList[i] < 0)
        numList.RemoveAt(i);
    }
    */
    
    //Good approach:
    for(int i = numList.Count - 1; i >= 0; i--)
    {
      if(numList[i] < 0)
        numList.RemoveAt(i);
    }

    culledList = numList;
# ---------- end l_03_removeitemfromlist ----------

# ---- group: RH_OUT:culled_list
number = Number(l_03_removeitemfromlist.culledList)

# ----
panel = Panel(number)
