# Grasshopper definition L_04_RandomNumberGenerator.gh (Grasshopper 1.0.7)

min = GetNumber(Slider(12, range=0..100), AtLeast=1, AtMost=1, Maximum=1.797693135e+308, Minimum=-1.797693135e+308)
max = GetNumber(Slider(71, range=0..100), AtLeast=1, AtMost=1, Maximum=1.797693135e+308, Minimum=-1.797693135e+308)
count = GetInteger(Slider(5, range=0..10), AtLeast=1, AtMost=1, Maximum=2147483647, Minimum=-2147483648)
seed = GetInteger(Slider(9, range=0..10), AtLeast=1, AtMost=1, Maximum=2147483647, Minimum=-2147483648)
l_04_randomnumbergenerator = L_04_RandomNumberGenerator(min=min, max=max, count=count, seed=seed)  # -> out, numbers; inputs min: Double, max: Double, count: Int32, seed: Int32
# ---------- l_04_randomnumbergenerator: C# usings ----------
using System.IO;
using System.Linq;
using System.Data;
using System.Drawing;
using System.Reflection;
using System.Windows.Forms;
using System.Xml;
using System.Xml.Linq;
using System.Runtime.InteropServices;

using Rhino.DocObjects;
using Rhino.Collections;
using GH_IO;
using GH_IO.Serialization;
# ---------- l_04_randomnumbergenerator: C# ----------
    Component.Message = "Random numbers";

    Random randGen = new Random(seed);
    List<double> randomNumbers = new List<double>();

    for(int i = 0; i < count; i++)
    {
      randomNumbers.Add(randGen.NextDouble() * (max - min) + min);
      //Random.NextDouble() returns a value between 0.0 and 1.0
      //(actually 0.99999999999999978 because of binary representation of a floating point number)
    }

    numbers = randomNumbers;
# ---------- end l_04_randomnumbergenerator ----------

# ---- group: RH_OUT:numbers
number = Number(l_04_randomnumbergenerator.numbers)

# ----
panel = Panel(number)
