# Grasshopper definition L_05_List3DPointAndRandomClass.gh (Grasshopper 1.0.7)

height = GetInteger(Slider(6, range=0..10), AtLeast=1, AtMost=1, Maximum=2147483647, Minimum=-2147483648)
spacing = GetNumber(Slider(0.68, range=0..10), AtLeast=1, AtMost=1, Maximum=1.797693135e+308, Minimum=-1.797693135e+308)
amplitude = GetNumber(Slider(4.99, range=0..10), AtLeast=1, AtMost=1, Maximum=1.797693135e+308, Minimum=-1.797693135e+308)
seed = GetInteger(Slider(10, range=0..10), AtLeast=1, AtMost=1, Maximum=2147483647, Minimum=-2147483648)
l_05_list3dpointandrandomclass = L_05_List3DPointAndRandomClass(height=height, spacing=spacing, amplitude=amplitude, seed=seed)  # -> out, points; inputs height: Int32, spacing: Double, amplitude: Double, seed: Int32
# ---------- l_05_list3dpointandrandomclass: C# usings ----------
using System.IO;
using System.Linq;
using System.Data;
using System.Drawing;
using System.Reflection;
using System.Windows.Forms;
using System.Xml;
using System.Xml.Linq;
using System.Runtime.InteropServices;

using Rhino.DocObjects;
using Rhino.Collections;
using GH_IO;
using GH_IO.Serialization;
# ---------- l_05_list3dpointandrandomclass: C# ----------
    Component.Message = "Point tower";

    Random myRandGen = new Random(seed);
    List<Point3d> ptList = new List<Point3d>(height); //no need to provide initial capacity, but it's faster
    Vector3d translation = new Vector3d(amplitude, 0, 0);
    Point3d lastPt = new Point3d();

    int i = 0;
    while(i < height)
    {
      double radAngle = (double) myRandGen.Next(0, 359) / 180 * Math.PI;
      translation.Rotate(radAngle, Vector3d.ZAxis);
      lastPt += translation;
      lastPt.Z = i * spacing;
      ptList.Add(lastPt);
      i++;
    }

    points = ptList;
# ---------- end l_05_list3dpointandrandomclass ----------

# ---- group: RH_OUT:pt_tower
point = Point(l_05_list3dpointandrandomclass.points)

# ----
interpolate = Interpolate(Vertices=l_05_list3dpointandrandomclass.points, Degree=3, Periodic=False, KnotStyle=1)  # -> Curve, Length, Domain
panel = Panel(point)
