# Grasshopper definition M_12_OutModifierExample#1.gh (Grasshopper 1.0.7)

circle = Circle(Plane=PlaneXY(0, 0, 0), Radius=1)
construct_point = ConstructPoint(XCoordinate=0, YCoordinate=Slider(0.53, range=0..1), ZCoordinate=0)
crv = GetGeometry(circle, AtLeast=1, AtMost=1, Filter=1073741828)
pt = GetGeometry(construct_point, AtLeast=1, AtMost=1, Filter=1073741825)
m_12_outmodifierexample_1 = M_12_OutModifierExample1(pt=pt, crv=crv)  # -> out, P, t, D; inputs pt: Point3d, crv: Curve
# ---------- m_12_outmodifierexample_1: C# ----------
    Component.Message = "Curve closest point";

    bool flag = false;
    double parameter;
    flag = crv.ClosestPoint(pt, out parameter);
    if(flag)
    {
      Print("Success!");
      P = crv.PointAt(parameter);
      t = parameter;
      D = pt.DistanceTo((Point3d) P); //unboxing conversion needed here
    }
    else
    {
      throw new InvalidOperationException("Finding closest point failed");
    }
# ---------- end m_12_outmodifierexample_1 ----------

# ---- group: RH_OUT:out
text = Text(m_12_outmodifierexample_1.out)

# ---- group: RH_OUT:pt
point = Point(m_12_outmodifierexample_1.P)

# ---- group: RH_OUT:parameter
number = Number(m_12_outmodifierexample_1.t)

# ---- group: RH_OUT:distance
number_2 = Number(m_12_outmodifierexample_1.D)

# ----
panel = Panel(text)
panel_2 = Panel(number)
panel_3 = Panel(number_2)
