# Grasshopper definition M_14_CalculatorEnumSwitch.gh (Grasshopper 1.0.7)

calculation_type = GetInteger(
    Slider(0, range=0..10),
    AtLeast=1,
    AtMost=1,
    Maximum=2147483647,
    Minimum=-2147483648,
    Prompt="0 = +, 1 = -, 2 = *, 3 = /, default = 0")
numa = GetNumber(Slider(2, range=0..10), AtLeast=1, AtMost=1, Maximum=1.797693135e+308, Minimum=-1.797693135e+308)
numb = GetNumber(Slider(3.12, range=0..10), AtLeast=1, AtMost=1, Maximum=1.797693135e+308, Minimum=-1.797693135e+308)
m_14_calculatorenumswitch = M_14_CalculatorEnumSwitch(calculationType=calculation_type, A=numa, B=numb)  # -> out, result; inputs calculationType: Int32, A: Double, B: Double
# ---------- m_14_calculatorenumswitch: C# usings ----------
using System.IO;
using System.Linq;
using System.Data;
using System.Drawing;
using System.Reflection;
using System.Windows.Forms;
using System.Xml;
using System.Xml.Linq;
using System.Runtime.InteropServices;

using Rhino.DocObjects;
using Rhino.Collections;
using GH_IO;
using GH_IO.Serialization;
# ---------- m_14_calculatorenumswitch: C# ----------
    Component.Message = "Calculator";
    CalcType option;

    switch(calculationType)
    {
      case 0: option = CalcType.addition; break;
      case 1: option = CalcType.subtraction; break;
      case 2: option = CalcType.multiplication; break;
      case 3: option = CalcType.division; break;
      default: option = CalcType.error; break;
    }

    result = Compute(A, B, option);
# ---------- m_14_calculatorenumswitch: C# additional code ----------
  private double Compute(double num1, double num2, CalcType type)
  {
    //in case your switch case ends with return, you don't need "break;'s"
    //this is because other statements wouldn't execute anyway
    switch(type)
    {
      case CalcType.addition: return num1 + num2;
      case CalcType.subtraction: return num1 - num2;
      case CalcType.multiplication: return num1 * num2;
      case CalcType.division: return num1 / num2;
      default: return 0;
    }
  }

  enum CalcType
  {
    addition,
    subtraction,
    multiplication,
    division,
    error = 100
  }
# ---------- end m_14_calculatorenumswitch ----------

# ---- group: RH_OUT:result
number = Number(m_14_calculatorenumswitch.result)

# ----
panel = Panel(number)
