# Grasshopper definition M_15_IdealElasticBounce.gh (Grasshopper 1.0.7)

local_normalx = GetNumber(Slider(1, range=0..1), AtLeast=1, AtMost=1, Maximum=1.797693135e+308, Minimum=-1.797693135e+308)
local_normaly = GetNumber(Slider(1, range=0..1), AtLeast=1, AtMost=1, Maximum=1.797693135e+308, Minimum=-1.797693135e+308)
local_normalz = GetNumber(Slider(1, range=0..1), AtLeast=1, AtMost=1, Maximum=1.797693135e+308, Minimum=-1.797693135e+308)
speed_vectorx = GetNumber(Slider(1, range=0..1), AtLeast=1, AtMost=1, Maximum=1.797693135e+308, Minimum=-1.797693135e+308)
speed_vectoy = GetNumber(Slider(0, range=0..1), AtLeast=1, AtMost=1, Maximum=1.797693135e+308, Minimum=-1.797693135e+308)
speed_vectorz = GetNumber(Slider(0, range=0..1), AtLeast=1, AtMost=1, Maximum=1.797693135e+308, Minimum=-1.797693135e+308)
vector_xyz = VectorXYZ(XComponent=speed_vectorx, YComponent=0, ZComponent=0)  # -> Vector, Length
vector_xyz_2 = VectorXYZ(XComponent=local_normalx, YComponent=local_normaly, ZComponent=local_normalz)  # -> Vector, Length
m_15_idealelasticbounce = M_15_IdealElasticBounce(speedVector=vector_xyz.Vector, localNormal=vector_xyz_2.Vector)  # -> out, speedVEC, localNOR, bounceVector; inputs speedVector: Vector3d, localNormal: Vector3d
# ---------- m_15_idealelasticbounce: C# usings ----------
using System.IO;
using System.Linq;
using System.Data;
using System.Drawing;
using System.Reflection;
using System.Windows.Forms;
using System.Xml;
using System.Xml.Linq;
using System.Runtime.InteropServices;

using Rhino.DocObjects;
using Rhino.Collections;
using GH_IO;
using GH_IO.Serialization;
# ---------- m_15_idealelasticbounce: C# ----------
    Component.Message = "Calculate bounce";
    Component.Description = "Calculates an ideally elastic bounce";

    bounceVector = ComputeBounceVector(speedVector, localNormal);

    speedVEC = speedVector;
    localNOR = localNormal;
# ---------- m_15_idealelasticbounce: C# additional code ----------
  private Vector3d ComputeBounceVector(Vector3d speed, Vector3d normalVectorAtBounce)
  {
    Vector3d perpSpeed = ((speed * normalVectorAtBounce) / (normalVectorAtBounce * normalVectorAtBounce)) * normalVectorAtBounce;
    Vector3d parallelSpeed = speed - perpSpeed;
    return parallelSpeed - perpSpeed;
  }
# ---------- end m_15_idealelasticbounce ----------
vector_display = VectorDisplay(Anchor=vector_xyz.Vector, Vector=vector_xyz.Vector)

# ---- group: RH_OUT:localNOR
vector = Vector(m_15_idealelasticbounce.localNOR)

# ---- group: RH_OUT:bounce_vector
vector_2 = Vector(m_15_idealelasticbounce.bounceVector)

# ---- group: RH_OUT:speedVEC
vector_3 = Vector(m_15_idealelasticbounce.speedVEC)

# ----
vector_display_2 = VectorDisplay(Anchor=vector_3, Vector=vector_3)
vector_display_3 = VectorDisplay(Anchor=vector, Vector=vector)
vector_display_4 = VectorDisplay(Anchor=vector_2, Vector=vector_2)
