# Grasshopper definition M_16_ReturnSymetryPlane.gh (Grasshopper 1.0.7)

number_slider = Slider(1, range=0..1)
construct_point = ConstructPoint(XCoordinate=number_slider, YCoordinate=0, ZCoordinate=0)
construct_point_2 = ConstructPoint(XCoordinate=0, YCoordinate=number_slider, ZCoordinate=0)
construct_point_3 = ConstructPoint(XCoordinate=0, YCoordinate=0, ZCoordinate=number_slider)
pt1 = GetPoint(construct_point, AtLeast=1, AtMost=1, Realtime=True)
pt2 = GetPoint(construct_point_2, AtLeast=1, AtMost=1, Realtime=True)
pt3 = GetPoint(construct_point_3, AtLeast=1, AtMost=1, Realtime=True)
m_16_returnsymetryplane = M_16_ReturnSymetryPlane(point1=pt1, point2=pt2, point3=pt3)  # -> out, symmetryPlane; inputs point1: Point3d, point2: Point3d, point3: Point3d
# ---------- m_16_returnsymetryplane: C# usings ----------
using System.IO;
using System.Linq;
using System.Data;
using System.Drawing;
using System.Reflection;
using System.Windows.Forms;
using System.Xml;
using System.Xml.Linq;
using System.Runtime.InteropServices;

using Rhino.DocObjects;
using Rhino.Collections;
using GH_IO;
using GH_IO.Serialization;
# ---------- m_16_returnsymetryplane: C# ----------
    Component.Message = "Plane of symmetry";

    symmetryPlane = SymmetryPlane3Pt(point1, point2, point3);
# ---------- m_16_returnsymetryplane: C# additional code ----------
  private Plane SymmetryPlane3Pt(Point3d pt1, Point3d midPt, Point3d pt2)
  {
    Vector3d vec1 = new Vector3d(pt1 - midPt);
    Vector3d vec2 = new Vector3d(pt2 - midPt);

    vec1.Unitize();
    vec2.Unitize();
    double dotProduct = vec1 * vec2;

    if(dotProduct == 1 || dotProduct == -1) //parallel vectors
    {
      return new Plane(midPt, -vec1);
    }
    else
    {
      return new Plane(midPt, Vector3d.CrossProduct(vec1, vec2), vec1 + vec2);
    }
  }
# ---------- end m_16_returnsymetryplane ----------
panel = Panel(m_16_returnsymetryplane.out)

# ---- group: RH_OUT:symetry_plane
plane = Plane(m_16_returnsymetryplane.symmetryPlane)
