# Grasshopper definition M_17_ArrayFromStartEndValues.gh (Grasshopper 1.0.7)

start = GetInteger(Slider(2, range=0..10), AtLeast=1, AtMost=1, Maximum=2147483647, Minimum=-2147483648)
end = GetInteger(Slider(10, range=0..10), AtLeast=1, AtMost=1, Maximum=2147483647, Minimum=-2147483648)
m_17_arrayfromstartendvalues = M_17_ArrayFromStartEndValues(start=start, end=end)  # -> out, A; inputs start: Int32, end: Int32
# ---------- m_17_arrayfromstartendvalues: C# ----------
    Component.Message = "Array start/end";
    A = Range(start, end);
# ---------- m_17_arrayfromstartendvalues: C# additional code ----------
  int[] Range(int start, int end)
  {
    int count = (end - start) + 1;
    if(count < 1)
      return null;
    int[] range = new int[count];
    for(int i = 0; i != count; ++i)
    {
      range[i] = start + i;
    }
    return range;
  }
# ---------- end m_17_arrayfromstartendvalues ----------

# ---- group: RH_OUT:intArray
integer = Integer(m_17_arrayfromstartendvalues.A)

# ----
panel = Panel(integer)
