# Grasshopper definition N_01_ClassPoint2D.gh (Grasshopper 1.0.7)

gene_pool = GenePool(
    Decimals=2,
    Maximum=100,
    Minimum=0,
    Value=[26.93015268, 67.49097186, 76.36652066, 13.04115076, 77.65384376, 36.57451795, 80.36634195, 55.37342245, 37.72158704, 53.22931025])
gene_pool_2 = GenePool(
    Decimals=2,
    Maximum=100,
    Minimum=0,
    Value=[60.11146701, 8.889402034, 56.86245428, 0, 97.57805173, 22.71288644, 34.97870859, 99.36376177, 88.06503559, 11.24955239])
number_slider = Slider(5.3, range=0..10)
number_slider_2 = Slider(4.9, range=0..10)
numx = GetNumber(gene_pool, AtLeast=1, AtMost=1, Maximum=1.797693135e+308, Minimum=-1.797693135e+308)
numy = GetNumber(gene_pool_2, AtLeast=1, AtMost=1, Maximum=1.797693135e+308, Minimum=-1.797693135e+308)
n_01_classpoint2d = N_01_ClassPoint2D(x=numx, y=numy)  # -> out, coordsX, coordsY; inputs x: Double, y: Double
# ---------- n_01_classpoint2d: C# usings ----------
using System.IO;
using System.Linq;
using System.Data;
using System.Drawing;
using System.Reflection;
using System.Windows.Forms;
using System.Xml;
using System.Xml.Linq;
using System.Runtime.InteropServices;

using Rhino.DocObjects;
using Rhino.Collections;
using GH_IO;
using GH_IO.Serialization;
# ---------- n_01_classpoint2d: C# ----------
    Component.Message = "Point2d";
    Point2d myPoint = new Point2d();  //default constructor
    myPoint.X = x;
    myPoint.Y = y;

    Print("myPoint x: {0}, y: {1}", myPoint.X, myPoint.Y);

    coordsX = x;
    coordsY = y;
# ---------- n_01_classpoint2d: C# additional code ----------
  class Point2d
  {
    public double X;
    public double Y;
  }
# ---------- end n_01_classpoint2d ----------

# ---- group: RH_OUT:out
text = Text(n_01_classpoint2d.out)

# ---- group: RH_OUT:coordsY
number = Number(n_01_classpoint2d.coordsY)

# ----
rh_out_coordsx = Number(n_01_classpoint2d.coordsX)
construct_point = ConstructPoint(XCoordinate=rh_out_coordsx, YCoordinate=number, ZCoordinate=0)
panel = Panel(text)
