# Grasshopper definition N_03_ClassParticle.gh (Grasshopper 1.0.7)

velocityx = GetNumber(Slider(7.01, range=0..10), AtLeast=1, AtMost=1, Maximum=1.797693135e+308, Minimum=-1.797693135e+308)
velocityy = GetNumber(Slider(0, range=0..10), AtLeast=1, AtMost=1, Maximum=1.797693135e+308, Minimum=-1.797693135e+308)
velocityz = GetNumber(Slider(0, range=0..10), AtLeast=1, AtMost=1, Maximum=1.797693135e+308, Minimum=-1.797693135e+308)
vector_xyz = VectorXYZ(XComponent=velocityx, YComponent=velocityy, ZComponent=velocityz)  # -> Vector, Length
construct_point = ConstructPoint(XCoordinate=0, YCoordinate=0, ZCoordinate=0)
particle_location = GetPoint(construct_point, AtLeast=1, AtMost=1, Realtime=True)
boolean_reset = GetInteger(Toggle(True), AtLeast=1, AtMost=1, Maximum=2147483647, Minimum=-2147483648)
boolean_run = GetInteger(Toggle(True), AtLeast=1, AtMost=1, Maximum=2147483647, Minimum=-2147483648)
acceleration = GetNumber(Slider(1.05, range=0..2), AtLeast=1, AtMost=1, Maximum=1.797693135e+308, Minimum=-1.797693135e+308)
vector_display = VectorDisplay(Anchor=vector_xyz.Vector, Vector=vector_xyz.Vector)
n_03_classparticle = N_03_ClassParticle(
    reset=boolean_reset,
    run=boolean_run,
    particleLocation=particle_location,
    particleVelocity=vector_xyz.Vector,
    acceleration=acceleration)  # -> out, particle_VEL_out, acceleration_out, currentPosition; inputs reset: Boolean, run: Boolean, particleLocation: Point3d, particleVelocity: Vector3d, acceleration: Double
# ---------- n_03_classparticle: C# usings ----------
using System.IO;
using System.Linq;
using System.Data;
using System.Drawing;
using System.Reflection;
using System.Windows.Forms;
using System.Xml;
using System.Xml.Linq;
using System.Runtime.InteropServices;

using Rhino.DocObjects;
using Rhino.Collections;
using GH_IO;
using GH_IO.Serialization;
# ---------- n_03_classparticle: C# ----------
    if(reset)
    {
      myParticle = new Particle(particleLocation, particleVelocity);
    }
    else if (run)
    {
      myParticle.Move();
      myParticle.Accelerate(acceleration);
    }
    currentPosition = myParticle.Location;

    particle_VEL_out = particleVelocity;
    acceleration_out = acceleration;
# ---------- n_03_classparticle: C# additional code ----------
  Particle myParticle = new Particle();

  class Particle
  {
    ///////   Constructors here     ////////
    public Particle()
    {
      Location = new Point3d(0, 0, 0);
      Velocity = new Vector3d(1, 0.5, 0);
    }

    public Particle(Point3d initLoc, Vector3d initVelo) : this()
    {
      Location = initLoc;
      Velocity = initVelo;
    }

    ///    End of constructors

    /// Properties:
    public Point3d Location {private set; get;}
    public Vector3d Velocity {private set; get;}

    // Methods:
    public void Move()
    {
      Location += Velocity;
    }

    public void Accelerate(double factor)
    {
      Velocity *= factor;
    }
  }
# ---------- end n_03_classparticle ----------

# ---- group: RH_OUT:particle_velocity_out
vector = Vector(n_03_classparticle.particle_VEL_out)

# ---- group: RH_OUT:acceleration_out
number = Number(n_03_classparticle.acceleration_out)

# ---- group: RH_OUT:current_position
point = Point(n_03_classparticle.currentPosition)

# ----
panel = Panel(number)
panel_2 = Panel(point)
panel_3 = Panel(vector)
vector_display_2 = VectorDisplay(Anchor=vector, Vector=vector)
