# Grasshopper definition P_01_PointTower.gh (Grasshopper 1.0.7)

reset = GetInteger(Toggle(False), AtLeast=1, AtMost=1, Maximum=2147483647, Minimum=-2147483648)
run = GetInteger(Toggle(True), AtLeast=1, AtMost=1, Maximum=2147483647, Minimum=-2147483648)
countx = GetInteger(Slider(3, range=0..10), AtLeast=1, AtMost=1, Maximum=2147483647, Minimum=-2147483648)
county = GetInteger(Slider(3, range=0..10), AtLeast=1, AtMost=1, Maximum=2147483647, Minimum=-2147483648)
counz = GetInteger(Slider(4, range=0..10), AtLeast=1, AtMost=1, Maximum=2147483647, Minimum=-2147483648)
span = GetNumber(Slider(2.581, range=0..10), AtLeast=1, AtMost=1, Maximum=1.797693135e+308, Minimum=-1.797693135e+308)
amplitude = GetNumber(Slider(6.014, range=0..10), AtLeast=1, AtMost=1, Maximum=1.797693135e+308, Minimum=-1.797693135e+308)
seed = GetInteger(Slider(2, range=0..10), AtLeast=1, AtMost=1, Maximum=2147483647, Minimum=-2147483648)
p_01_pointtower = P_01_PointTower(reset=reset, run=run, xCount=countx, yCount=county, zCount=counz, span=span, amplitude=amplitude, seed=seed)  # -> out, points; inputs reset: Boolean, run: Boolean, xCount: Int32, yCount: Int32, zCount: Int32, span: Double, amplitude: Double, seed: Int32
# ---------- p_01_pointtower: C# ----------
    Component.Message = "Point pillars";

    if(reset)
      limit = 1;
    else if(run)
    {
      List<GH_Point> ptListGH = new List<GH_Point>(); //GH_Point - fast
      //List<Point3d> ptList = new List<Point3d>(); // Point3d - slow

      Point3d startPt = new Point3d(0, 0, 0);
      double radAngle = 0;

      for(int i = 0; i < xCount; i++)
      {
        for(int j = 0; j < yCount; j++)
        {
          Polyline pLine = new Polyline();
          Random randomGen = new Random(seed + i * xCount + j); // different generators for different pillars
          Vector3d translation = new Vector3d(amplitude, 0, 0);

          double x = (i * span) + startPt.X;
          double y = (j * span) + startPt.Y;
          double z = startPt.Z;
          Point3d lastPt = new Point3d(x, y, z);
          for(int k = 0; k < limit; k++)
          {
            radAngle = (double) randomGen.Next(0, 359) / (double) 180 * Math.PI;
            translation.Rotate(radAngle, Vector3d.ZAxis);
            lastPt += translation;
            lastPt.Z = k * span;

            ptListGH.Add(new GH_Point(lastPt));
            //ptList.Add(lastPt);

          }
        }
      }

      points = ptListGH;
      //points = ptList;
      limit++;
      if(limit <= zCount)
        Component.ExpireSolution(true);
    }
# ---------- p_01_pointtower: C# additional code ----------
  int limit = 1;
# ---------- end p_01_pointtower ----------

# ---- group: RH_OUT:points
point = Point(p_01_pointtower.points)

# ----
panel = Panel(point)
