# Grasshopper definition P_02_NumberSorting.gh (Grasshopper 1.0.7)

gene_pool = GenePool(
    Decimals=0,
    Maximum=100,
    Minimum=0,
    Value=[66.97601386, 68.91705658, 38.16026009, 37.41305565, 57.81295563, 17.12310753, 52.14630745, 18.1670107, 62.70201563, 83.94794855])
int_list = GetNumber(gene_pool, AtLeast=1, AtMost=1, Maximum=1.797693135e+308, Minimum=-1.797693135e+308)
p_02_numbersorting = P_02_NumberSorting(intList=int_list)  # -> out, sorted; inputs intList: list of Int32
# ---------- p_02_numbersorting: C# ----------
    int[] myArray = intList.ToArray();
    BubbleSort(myArray);
    sorted = myArray;
# ---------- p_02_numbersorting: C# additional code ----------
  void BubbleSort(int[] array)
  {
    int temp = 0;
    for(int i = array.Length - 1; i >= 1; i--)
    {
      for(int j = 0; j < i; j++)
      {
        if(array[j] > array[j + 1])
        {
          temp = array[j];
          array[j] = array[j + 1];
          array[j + 1] = temp;
        }
      }
    }
  }
# ---------- end p_02_numbersorting ----------

# ---- group: RH_OUT:sorted
number = Number(p_02_numbersorting.sorted)

# ----
panel = Panel(number)
