# Grasshopper definition P_03_BubbleSortingExercise.gh (Grasshopper 1.0.7)

gene_pool = GenePool(
    Decimals=2,
    Maximum=10,
    Minimum=0,
    Value=[0.2423242294, 0.2287141887, 5.956019343, 7.830118727, 9.838533727, 1.408946147, 6.246604857, 4.492615165, 6.806325524, 3.65022089, 8.086187904, 3.419938257, 9.296974833, 3.257077682, 4.463465854, 4.998256771, 2.86448965, 9.323777831, 1.626273739, 5.176027368])
values = GetNumber(gene_pool, AtLeast=1, AtMost=1, Maximum=1.797693135e+308, Minimum=-1.797693135e+308)
reset = GetInteger(Toggle(True), AtLeast=1, AtMost=1, Maximum=2147483647, Minimum=-2147483648)
run = GetInteger(Toggle(True), AtLeast=1, AtMost=1, Maximum=2147483647, Minimum=-2147483648)
p_03_bubblesortingexercise = P_03_BubbleSortingExercise(reset=reset, run=run, values=values)  # -> out, A; inputs reset: Boolean, run: Boolean, values: list of Double
# ---------- p_03_bubblesortingexercise: C# usings ----------
using System.IO;
using System.Linq;
using System.Data;
using System.Drawing;
using System.Reflection;
using System.Windows.Forms;
using System.Xml;
using System.Xml.Linq;
using System.Runtime.InteropServices;

using Rhino.DocObjects;
using Rhino.Collections;
using GH_IO;
using GH_IO.Serialization;
# ---------- p_03_bubblesortingexercise: C# ----------
    Component.Message = "Bubble sorting visualisation";

    if(reset)
    {
      ptList = new List<Point3d>(values.Count);
      maxIndex = values.Count - 1;
      for(int i = 0; i < values.Count; i++)
        ptList.Add(new Point3d(values[i], i, 0));
    }
    else if(run && maxIndex >= 1)
    {
      Point3d ptA, ptB;
      for(int j = 0; j < maxIndex; j++)
      {
        if(ptList[j].X > ptList[j + 1].X)
        {
          ptA = ptList[j];
          ptB = ptList[j + 1];

          ptA.Y = j + 1;
          ptB.Y = j;

          ptList[j] = ptB;
          ptList[j + 1] = ptA;
        }
      }
      maxIndex--;
    }

    A = ptList;
# ---------- p_03_bubblesortingexercise: C# additional code ----------
  List<Point3d> ptList;
  int maxIndex;
# ---------- end p_03_bubblesortingexercise ----------

# ---- group: RH_OUT:points
point = Point(p_03_bubblesortingexercise.A)

# ----
panel = Panel(p_03_bubblesortingexercise.A)
